# Grasshopper definition AIA_GeoOpt_Assignment1_Pedro.gh (Grasshopper 1.0.7)

# ----
# Anatomy
# point 3d
# Polyline
# Nurb curves
number_slider = Slider(10, range=0..10)  # disabled
number_slider_2 = Slider(4, range=0..10)  # disabled
number_slider_3 = Slider(7, range=0..10)  # disabled
# Class Notes
number_slider_4 = Slider(20, range=0..100)  # disabled
number_slider_5 = Slider(60, range=0..100)  # disabled
number_slider_6 = Slider(7, range=0..10)  # disabled
number_slider_7 = Slider(5, range=0..10)  # disabled
number_slider_8 = Slider(27, range=0..100)  # disabled
point = Point(Point(4, 4, 0))  # disabled
point_2 = Point([Point(7, 16, 0), Point(0, 16, 0), Point(0, 10, 0), Point(21, 10, 0), Point(13.21162356, 15.19304617, 0), Point(10.76289806, 7.936372024, 0), Point(7.668530533, 5.859012667, 0)])  # disabled
point_3 = Point(Point(9, 2, 0))  # disabled
ghpython_script = GhPythonScript(x=number_slider_4, y=number_slider_5)  # -> out, a, b; inputs x: Int32, y: Int32; disabled
# ---------- ghpython_script: Python ----------
import Rhino.Geometry as rg

print ("hello world")

print (x)
print (type(x))

a = x
b = x + y
print (b)
# ---------- end ghpython_script ----------
ghpython_script_2 = GhPythonScript(x=number_slider_7)  # -> out, a, b; inputs x: Int32; disabled
# ---------- ghpython_script_2: Python ----------
import Rhino.Geometry as rg

pointlist2 = []

for i in range (x):
    for j in range (x):
        for k in range (x):
            pt = rg.Point3d(i,j,k)
            pointlist2.append(pt)

# a = pointlist2


# create a polyline

poly = rg.Polyline(pointlist2)
print (poly)

b = [poly]
# ---------- end ghpython_script_2 ----------
ghpython_script_3 = GhPythonScript(x=point, y=point_3, z=number_slider_8, u=point_2)  # -> out, a, b; inputs x: Point3d, y: Point3d, u: list; disabled
# ---------- ghpython_script_3: Python ----------
import Rhino.Geometry as rg

print (x)
print (type (x))

# constrcut a line

lineA = rg.Line (x,y)
a = lineA


# list of lines

line_list = []

for i in range (50):
    pt = rg.Point3d (y.X, i, 0)
    l = rg.Line(x,pt)
    line_list.append(l)
    
b = line_list


#/////// CURVES (Nurbscurves) ////////


print(u)
print(type(u))

N_curve = rg.NurbsCurve.create (False, y, z)
# ---------- end ghpython_script_3 ----------
ghpython_script_4 = GhPythonScript(x=number_slider, y=number_slider_2, z=number_slider_3, u=number_slider_6)  # -> out, a, b, c, d, e; inputs x: Int32, y: Int32, z: Int32, u: Int32; disabled
# ---------- ghpython_script_4: Python ----------
import Rhino.Geometry as rg

# create geometry - point3d

p = rg.Point3d( 10, 10, 0)
print(p)
print(type(p))

a = p #output the point and display it in GH

b = rg.Point3d(x,y,z)

# create a list of points

pointlist = [] # create an empty list

for i in range ( int(x)):
    p = rg.Point3d(i, 0, 0)
    pointlist.append(p)
print (len(pointlist))

c = pointlist

# access to one point of the list

print pointlist [3]
print pointlist [3].X

# access to all point of the list

for pt in pointlist:
    print (pt.X)

# access the index of a list

for i in range (len(pointlist)):
    print (i)


# Nested loops

pointlist2 = []

for i in range (u):
    for j in range (u):
        for k in range (u):
            pt = rg.Point3d(i,j,k)
            pointlist2.append(pt)

e = pointlist2
# ---------- end ghpython_script_4 ----------
panel = Panel(ghpython_script_4.e)  # disabled
data = Data(ghpython_script_3.b)  # disabled
panel_2 = Panel(ghpython_script.out)  # disabled
data_2 = Data(ghpython_script_3.a)  # disabled
panel_3 = Panel(ghpython_script.a)  # disabled
panel_4 = Panel(ghpython_script.b)  # disabled
panel_5 = Panel(ghpython_script_2.b)  # disabled
data_3 = Data(ghpython_script_4.e)  # disabled

# ----
# Revise Video
# 01. Anatomy of GHpython component
number_slider_9 = Slider(5, range=0..10)
ghpython_script_5 = GhPythonScript(x=number_slider_9, y=Slider(6, range=0..10))  # -> out, a, b; inputs x: Int32, y: Int32
# ---------- ghpython_script_5: Python ----------
import Rhino.Geometry as rg

#print ("Hello world")
#print (x)

#print (type(x))

a = x
b = x + y

print (a)
print (b)
# ---------- end ghpython_script_5 ----------
panel_6 = Panel(ghpython_script_5.b)
panel_7 = Panel(ghpython_script_5.out)
panel_8 = Panel(ghpython_script_5.a)

# ----
# 03. Polylines
number_slider_10 = Slider(2, range=0..10)
ghpython_script_6 = GhPythonScript(x=number_slider_10)  # -> out, a, b, c, d; inputs x: Int32
# ---------- ghpython_script_6: Python ----------
import Rhino.Geometry as rg

point_list = []

for i in range (x):
    for j in range (x):
        for k in range (x):
            pt = rg.Point3d(i,j,k)
            point_list.append(pt)
        
    
a = point_list

# CREATE A POLYLINE ///////////////

#create a polyline

poly = rg.Polyline(point_list)
print (poly)
b = [poly] # <---- To output a polyline go GH we need to use brackets (exception)

print (poly[3]) ## <---- Access point in a Polyline (same as to a list) 

c = (poly.BoundingBox)

d = poly.GetSegments()
# ---------- end ghpython_script_6 ----------
data_4 = Data(ghpython_script_6.b)
data_5 = Data(ghpython_script_6.c)
data_6 = Data(ghpython_script_6.d)

point_4 = Point([Point(-3.909279683, 14.29847933, 0), Point(-6.054315163, 11.83272544, 0), Point(5.302288796, 8.76850464, 0), Point(-1.622294713, 5.186558784, 0), Point(-5.161033994, 7.362821055, 0), Point(-7.985168084, 4.875505755, 0), Point(-4.936586755, 0.9525358447, 0), Point(-1.385443613, 1.336419269, 0), Point(1.053440234, 5.070319349, 0), Point(9.486466908, 5.076551224, 0), Point(1.74752029, -1.215278411, 0)])
point_5 = Point(Point(-3.982823183, -5.728522174, 0))
# 04. Lines and Curves
point_6 = Point(Point(7.820240287, 4.545663031, 0))
ghpython_script_7 = GhPythonScript(x=point_6, y=point_5, t=Slider(0.21, range=0..1), k=point_4, degree=Slider(3, range=0..10))  # -> out, a, b, c, d, e, nurbcurve; inputs x: Point3d, y: Point3d, k: list of Point3d, degree: Int32
# ---------- ghpython_script_7: Python ----------
import Rhino.Geometry as rg

# CONSTRUCT A LINE ///////////////

line = rg.Line(x,y)
a = line


line_list = []
midpt_list = []                 # midpoint in all lines

for i in range (50):
    pt = rg.Point3d ( y.X, i,0)
    l = rg.Line(x, pt)
    line_list.append (l)
    mp = l.PointAt(t)           # midpoint in all lines
    midpt_list.append(mp)       # midpoint in all lines
    
b = line_list
d = midpt_list                  # midpoint in all lines

len = line.Length # length of the line
print len 

#midpt = line.PointAt (0.5) # find a mid point of a line
#c = midpt

midpt = line.PointAt (t) # find a mid point of a line using sliders
c = midpt

#convert type from line to NurbeCurve

nc = line.ToNurbsCurve() 
print (type(nc))

#create polyline from midpoints

poly = [rg.Polyline(midpt_list)]
e = poly



# CONSTRUCT NURBS CURVE ///////////////

nurbcurve = rg.NurbsCurve.Create(False, degree, k)
# ---------- end ghpython_script_7 ----------
data_7 = Data(ghpython_script_7.a)
data_8 = Data(ghpython_script_7.e)
data_9 = Data(ghpython_script_7.b)
data_10 = Data(ghpython_script_7.d)
data_11 = Data(ghpython_script_7.c)
data_12 = Data(ghpython_script_7.nurbcurve)

# ----
# 02. Point 3D
number_slider_11 = Slider(10, range=0..10)
ghpython_script_8 = GhPythonScript(x=number_slider_11, y=Slider(7, range=0..10), z=Slider(6, range=0..10), u=Slider(10, range=0..10))  # -> out, a, b, c, d, e; inputs u: Int32
# ---------- ghpython_script_8: Python ----------
import Rhino.Geometry as rg

# Create geometry, a point 3D

# DEFINE POINTS BY COORDINATES /////////////

p = rg.Point3d(10,10,0) 
#print (p)
#print (type(p))

a = p      #<----output the point and display it in GH


# DEFINE POINTS BY SLIDERS /////////////

b = rg.Point3d(x,y,z)    

#X_component = b.X
#print (X_component) #<---Get or access to the point properties X (x, Y or Z).  


# CREATE LIST OF POINTS /////////////

pointlist =[]

for i in range(int(x)):
    p = rg.Point3d(i, 0, 0)
    pointlist.append (p)
    
#print (pointlist)
#print(len(pointlist))
c = pointlist

#print pointlist[3]
#print pointlist[3].X #<---Get or access to the point properties X in a list of points (x, Y or Z). 

#for i in range(len(pointlist)):
print(pointlist[i]) 


list_length = len(pointlist)
list_indexes = range(list_length)


# measure the distance between two points

dist_list = []

for i in list_indexes:
    if i != list_indexes[-1]:
        p1 = pointlist [i]
        p2 = pointlist [i+1]
    
        dist = rg.Point3d.DistanceTo(p1,p2)
        dist_list.append(dist)
d = dist_list


# NESTED LOOPS /////////////


# Grid of points

point_list2 = []

for i in range (u):
    for j in range (u):
        for k in range (u):
            pt = rg.Point3d(i,j,k)
            point_list2.append(pt)
        
    
e = point_list2
# ---------- end ghpython_script_8 ----------
panel_9 = Panel(ghpython_script_8.b)
panel_10 = Panel(ghpython_script_8.a)
panel_11 = Panel(ghpython_script_8.out)
data_13 = Data(ghpython_script_8.e)
panel_12 = Panel(ghpython_script_8.e)

number_slider_12 = Slider(10, range=0..10)  # disabled
number_slider_13 = Slider(10, range=0..10)  # disabled
ghpython_script_9 = GhPythonScript(x=number_slider_12, y=number_slider_12, z=number_slider_13)  # -> out, a, b, c, d, e; inputs x: Int32, y: Int32, z: Int32; disabled
# ---------- ghpython_script_9: Python ----------
import Rhino.Geometry as rg
import ghpythonlib.treehelpers as th #this one is to import nested lists to grasshopper trees
import math


# CREATE POINTS ////////////////////////

list_a = []
list_b = []

for i in range (int(x)):
   px = rg.Point3d(i, 0, 0)
   py = rg.Point3d(i, y, 0)
   list_a.append (px)
   list_b.append (py)

    
a = list_a
b = list_b

# CREATE LINES ////////////////////////

line_list = []


for i in range(x):
        l = rg.LineCurve (list_a[i], list_b[i])
        line_list.append(l)

c = line_list


# DIVIDE CURVE ////////////////////////

allDivPts = []      # List of lists

for i in line_list:
    linePts = []    # create an empty list to fill each iteration
    n_crv = i.ToNurbsCurve()
    div_crv = n_crv.DivideByCount (z,True)
    linePts.append(div_crv)
    
    divPts = []
    for p in  div_crv :
        divPts.append(n_crv.PointAt(p))
    allDivPts.append(divPts)
    
d = th.list_to_tree(allDivPts)
# ---------- end ghpython_script_9 ----------
data_14 = Data(ghpython_script_9.a)  # disabled
data_15 = Data(ghpython_script_9.b)  # disabled
data_16 = Data(ghpython_script_9.c)  # disabled
data_17 = Data(ghpython_script_9.d)  # disabled
data_18 = Data(ghpython_script_9.e)  # disabled
file_path = FilePath("C:\Users\Pedro\OneDrive\Ambiente de Trabalho\IAAC\MaCAD\Mod_3\02.Geo_Optimization\GeoOpt\a01\AIA_GeoOpt_Assignment1_Pedro.py")
read_file = ReadFile(File=file_path, PerLineParse=False)
# Assignment 01
panel_13 = Panel(read_file)
number_slider_14 = Slider(10, range=0..10)
ghpython_script_10 = GhPythonScript(Code=panel_13, X=number_slider_14, Y=number_slider_14, Z=Slider(10, range=0..10), U=Slider(3.3, range=0..10))  # -> Out, A, B, C, D, E
point_list = PointList(Points=ghpython_script_10.E, Size=Slider(0.305, range=0..1))
data_19 = Data(ghpython_script_10.B)
data_20 = Data(ghpython_script_10.C)
data_21 = Data(ghpython_script_10.E)
panel_14 = Panel(data_21)
panel_15 = Panel(ghpython_script_10.D)
