# Grasshopper definition AIA_GeoOpt_Assignment 2_Pedro.gh (Grasshopper 1.0.7)

file_path = FilePath("C:\Users\Pedro\OneDrive\Ambiente de Trabalho\IAAC\MaCAD\Mod_3\02.Geo_Optimization\GeoOpt\a01\GeoOpt\a02\a02.py")
read_file = ReadFile(File=file_path, PerLineParse=False)
# Assignment 2
python = GhPythonScript(x=Slider(10, range=1..20), y=Slider(10, range=1..20), U=Slider(20, range=1..20), V=Slider(20, range=1..20))  # -> out, a, c, d, e, f, g, h; inputs x: Int32, y: Int32, U: Int32, V: Int32
# ---------- python: Python ----------
import Rhino.Geometry as rg
import ghpythonlib.treehelpers as th
import math
import ghpythonlib.components as ghc

#this is how you initialize a list in python
pointList1 = []
pointList2 = []
for i in range(x):
    pt1 = rg.Point3d(i, 0, 0)
    pt2 = rg.Point3d(i, y, 0)
    pointList1.append(pt1)
    pointList2.append(pt2)

a = pointList1

lineList = []
for i in range(len(pointList1)):
    line = rg.Line(pointList1[i], pointList2[i])
    lineList.append(line)
c = lineList


allDivPts = []
for l in lineList:
    divPts = [] #my list of division points
    nc = l.ToNurbsCurve()
    params = nc.DivideByCount(V, True)
    for p in params:
        divPt = nc.PointAt(p)
        
        vec= rg.Vector3d(divPt)
        vecLen = vec.Length
        mag = math.sin(vecLen)
        transVec = -rg.Vector3d.ZAxis * mag
        
        newPt = divPt - transVec
        divPts.append(newPt)

    allDivPts.append(divPts)

d = th.list_to_tree(allDivPts)


#make a curve from list of points
curveList = []
for i in range(len(allDivPts)):
    curve = rg.Curve.CreateInterpolatedCurve(allDivPts[i], 3)
    curveList.append(curve)
e= curveList


#create a loft surface from curves
surface = rg.Brep.CreateFromLoft(curveList, rg.Point3d.Unset, rg.Point3d.Unset, rg.LoftType.Normal, False)
surface = surface[0].Faces[0]

f = surface

#reparametrize surface
surface.SetDomain(0,rg.Interval(0,U))
surface.SetDomain(1,rg.Interval(0,V))

#get points
allSrfPts=[]
for i in range(U+1):
    srfPts= []
    for j in range(V+1):
        pt=rg.Surface.PointAt(surface,i,j)
        srfPts.append(pt)
    allSrfPts.append(srfPts)
h = allSrfPts


mesh = rg.Mesh()
for i in range(len(allSrfPts)-1):
    for j in range(len(allSrfPts[i])-1):
        m = rg.Mesh()
        v1 = allSrfPts[i][j]
        v2 = allSrfPts[i][j+1]        
        v3 = allSrfPts[i+1][j+1]        
        v4 = allSrfPts[i+1][j]
        
        m.Vertices.Add(v1)
        m.Vertices.Add(v2)
        m.Vertices.Add(v3)
        m.Vertices.Add(v4)
        
        m.Faces.AddFace(0,1,2,3)
        
        mesh.Append(m)

g = mesh

cleanmesh = mesh
#methods to clean a mesh
cleanmesh.Normals.ComputeNormals()
cleanmesh.Vertices.CombineIdentical(True, True)
cleanmesh.Vertices.CullUnused()
cleanmesh.Weld(3.14159265358979)
cleanmesh.UnifyNormals()
cleanmesh.FaceNormals.ComputeFaceNormals()
cleanmesh.Compact()


h = cleanmesh
# ---------- end python ----------
panel = Panel(read_file)

# ---- group: replaceable mesh
mesh = Data(python.h)

# ---- group: create sun Vector
python_2 = GhPythonScript(x=Slider(0.6, range=0..1), y=Slider(0.83, range=0..1))  # -> out, a, b, c
# ---------- python_2: Python ----------
import Rhino.Geometry as rg
import math

#create a sun vector

#1. create a Sphere at point (0,0,0) with radius 1 and output it to a
#output the sphere to a

sphere_center = rg.Point3d (0,0,0)
sphere_radius = 1.0
sphere = rg.Sphere(sphere_center, sphere_radius)

a = sphere 

#2. evaluate a point in the sphere using rg.Sphere.PointAt() at coordintes x and y
#the point should only be on the upper half of the sphere (upper hemisphere)
#the angles are in radians, so you might want to use math.pi for this
#output the point to b


b = rg.Sphere.PointAt(a, x, y)

#create a vector from the origin and reverse the vector
#keep in mind that Reverse affects the original vector
#output the vector to c


vec = rg.Vector3d(b)
vec = rg.Vector3d.Negate(vec)

c = vec
# ---------- end python_2 ----------

# ----
brep = Brep(python_2.a)
vector = Vector(python_2.c)
panel_2 = Panel(python_2.c)
python_3 = GhPythonScript(Code=panel, X=Slider(10, range=0..10), Y=Slider(10, range=0..10), M=mesh, S=python_2.c)  # -> Out, A, B, C, D, MeshDup
vdis = VectorDisplay(Anchor=python_2.b, Vector=python_2.c)
panel_3 = Panel(python_3.A)
bnd = Bounds(Numbers=python_3.C)
vdis_2 = VectorDisplay(Anchor=python_3.B, Vector=python_3.A)
mesh_2 = Mesh(python_3.MeshDup)
dedomain = DeconstructDomain(Domain=bnd)  # -> Start, End
error = Panel(python_3.Out)
panel_4 = Panel(python_3.C)
gradient = Gradient(
    LowerLimit=dedomain.Start,
    UpperLimit=dedomain.End,
    Parameter=python_3.C,
    stops=[0: RGB(234, 38, 0), 0.25: RGB(234, 126, 0), 0.5: RGB(254, 244, 84), 0.75: RGB(173, 203, 249), 1: RGB(75, 107, 169)])
preview = CustomPreview(Geometry=python_3.D, Material=gradient)
